# Grasshopper definition Cone Majigga Fitted.gh (Grasshopper 1.0.4)
# plug-ins: Kangaroo2 Components

a = Slider(1.17, range=0.001..3)
h = Slider(300, range=1..320)
multiplication = Multiplication(A=h, B=9.9)
series = Series(Start=0, Step=0.1, Count=multiplication)
division = Division(A=h, B=3.274193548)
eval = Evaluate(F="(x-y)/x", x=h, y=series)
multiplication_2 = Multiplication(A=eval, B=division)
number_slider = Slider(2.35, range=0.001..10)
cone = Cone(Base=PlaneXY(0, 0, 0), Radius=division, Length=h)  # -> Cone, Tip
mesh = MeshBrep(
    Brep=cone.Cone,
    Settings={GridMaxCount=0, GridMinCount=16, JaggedSeams=False, MaxEdgeLength=0, MinEdgeLength=0.0001, MinTolerance=0, Refine=True, RefineAngle=0, RelativeTolerance=0.65, SimplePlanes=True, Tolerance=0})
pt = Point()
mesh_2 = Mesh(<mesh referenced from the Rhino model>)
Y = UnitY(Factor=1)
reset = BooleanToggle(False)
Z = UnitZ(Factor=1)
knob = ControlKnob(Decimals=4, Limit=True, Maximum=10, Minimum=0, Range=1, Value=1.2925)
multiplication_3 = Multiplication(A=series, B=knob)
sin = Sine(Value=multiplication_3)
cos = Cosine(Value=multiplication_3)
multiplication_4 = Multiplication(A=cos, B=multiplication_2)
multiplication_5 = Multiplication(A=sin, B=multiplication_2)
pt_2 = ConstructPoint(XCoordinate=multiplication_5, YCoordinate=multiplication_4, ZCoordinate=series)
intcrv = Interpolate(Vertices=pt_2, Degree=3, Periodic=False, KnotStyle=1)  # -> Curve, Length, Domain
divlength = DivideLength(Curve=intcrv.Curve, Length=Slider(4.7, range=0..10))  # -> Points, Tangents, Parameters
sph = Sphere(Base=divlength.Points, Radius=number_slider)
arrpolar = PolarArray(Geometry=divlength.Points, Plane=PlaneXY(0, 0, 0), Count=Slider(1, range=1..120), Angle=6.283185307)  # -> Geometry, Transform
sc = SphereCollide(Points=divlength.Points, Radius=number_slider, Strength=20)
multiplication_6 = Multiplication(A=Y, B=0.0001)
multiplication_7 = Multiplication(A=Z, B=0.01)
button = Button()
power = BooleanToggle(False)
reset_2 = BooleanToggle(False)
item = ListItem(List=reverse(divlength.Points), Index=0, Wrap=True)
onmesh = OnMesh(Points=divlength.Points, Mesh=mesh_2, Strength=10)
load = Load(Point=divlength.Points, ForceVector=multiplication_7)
pt_3 = Point(item)
anchor = Anchor(Point=pt_3, Strength=1000)
solver = Solver(GoalObjects=[load, sc, onmesh, anchor], Reset=reset_2, Threshold=4e-05, Tolerance=0.01, On=power)  # -> I, V, O
panel = Panel(solver.I)
pt_4 = Point(solver.V)
pt_5 = Point([<point referenced from the Rhino model> x564])
sph_2 = Sphere(Base=pt_4, Radius=Slider(1.5, range=1..4.7))
bbx = BrepBrep(BrepA=sph_2, BrepB=cone.Cone)  # -> Curves, Points
