# Grasshopper definition Cone majigga.gh (Grasshopper 1.0.4)
# plug-ins: Kangaroo2 Components

h = Slider(300, range=1..1320)
multiplication = Multiplication(A=h, B=9.9)
series = Series(Start=0, Step=0.1, Count=multiplication)
division = Division(A=Slider(203, range=-100..400), B=Slider(65, range=0..100))
division_2 = Division(A=h, B=division)
eval = Evaluate(F="(x-y)/x", x=h, y=series)
multiplication_2 = Multiplication(A=eval, B=division_2)
number_slider = Slider(2.35, range=0.001..10)
cone = Cone(Base=PlaneXY(0, 0, 0), Radius=division_2, Length=h)  # -> Cone, Tip
mesh = MeshBrep(
    Brep=cone.Cone,
    Settings={GridMaxCount=0, GridMinCount=16, JaggedSeams=False, MaxEdgeLength=0, MinEdgeLength=0.0001, MinTolerance=0, Refine=True, RefineAngle=0, RelativeTolerance=0.65, SimplePlanes=True, Tolerance=0})
fitted_at_top_points = Point([<point referenced from the Rhino model> x508])
mesh_2 = Mesh(<mesh referenced from the Rhino model>)
knob = ControlKnob(Decimals=4, Limit=True, Maximum=10, Minimum=0, Range=1, Value=0.1697)
multiplication_3 = Multiplication(A=series, B=knob)
sin = Sine(Value=multiplication_3)
cos = Cosine(Value=multiplication_3)
multiplication_4 = Multiplication(A=cos, B=multiplication_2)
multiplication_5 = Multiplication(A=sin, B=multiplication_2)
pt = ConstructPoint(XCoordinate=multiplication_5, YCoordinate=multiplication_4, ZCoordinate=series)
intcrv = Interpolate(Vertices=pt, Degree=3, Periodic=False, KnotStyle=1)  # -> Curve, Length, Domain
divlength = DivideLength(Curve=intcrv.Curve, Length=Slider(4.8, range=0..10))  # -> Points, Tangents, Parameters
sph = Sphere(Base=divlength.Points, Radius=number_slider)
arrpolar = PolarArray(Geometry=divlength.Points, Plane=PlaneXY(0, 0, 0), Count=Slider(8, range=1..120), Angle=6.283185307)  # -> Geometry, Transform
sc = SphereCollide(Points=flatten(arrpolar.Geometry), Radius=number_slider, Strength=50)
Y = UnitY(Factor=1)
reset = BooleanToggle(False)
Z = UnitZ(Factor=1)
grab = Grab(On=Toggle(True), Strength=100, Range=3)  # -> Grab, Anchors
multiplication_6 = Multiplication(A=Y, B=-0.0003)
item = ListItem(List=reverse(divlength.Points), Index=0, Wrap=True)
button = Button()
power = BooleanToggle(False)
onmesh = OnMesh(Points=arrpolar.Geometry, Mesh=mesh_2, Strength=15)
multiplication_7 = Multiplication(A=Z, B=0.01)
reset_2 = BooleanToggle(False)
load = Load(Point=arrpolar.Geometry, ForceVector=multiplication_7)
pt_2 = Point(item)
anchor = Anchor(Point=flatten(pt_2), Strength=1000)
solver = Solver(GoalObjects=[load, sc, onmesh, grab.Grab, anchor], Reset=reset_2, Threshold=4e-05, Tolerance=1.5, On=power)  # -> I, V, O
timer = Timer(TimerInterval=10000, Target=solver)
pt_3 = Point(solver.V)
panel = Panel(solver.I)
sph_2 = Sphere(Base=pt_3, Radius=Slider(2.35, range=1..4.7))
