# Grasshopper definition Cone manual.gh (Grasshopper 1.0.4)
# plug-ins: Kangaroo2 Components

pt = Point([<point referenced from the Rhino model> x5000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])
cone = Cone(Base=PlaneXY(0, 0, 0), Radius=Slider(65, range=0..100), Length=Slider(200, range=0..1000))  # -> Cone, Tip
sph = Sphere(Base=pt, Radius=Slider(1.5, range=0..10))
srf = Surface(<surface referenced from the Rhino model>)
mesh_uv = MeshSurface(Surface=cone.Cone, UCount=5, VCount=5, Overhang=False, Equalize=True)
unroller = Unroller(Strip=mesh_uv, Unroll=1)
