# Grasshopper definition DifferentialCRV.gh (Grasshopper 1.0.4)

number_slider = Slider(10, range=0..10)
number_slider_2 = Slider(100, range=0..100)
c_script = CSharpScript(
    NMax=Slider(100, range=0..1000000),
    SIZE=Slider(2800, range=0..10000),
    Procs=Slider(6, range=0..10),
    initNum=Slider(40, range=0..100),
    Mid=Slider(0.5, range=0..1))  # -> out, A; inputs NMax: Int32, SIZE: Int32, Procs: Int32, initNum: Int32, Mid: Double
# ---------- c_script: C# ----------
        //initialize vars
double ONE = 1.0/SIZE;
double initRAD = 25.0*ONE;
double STP = ONE*0.4;
double NEARL = 3*ONE;
double FARL = 40*ONE;
double LINEWIDTH = 5.0*ONE;
List<int> BACK = new List<int>();
BACK.Add(1);
BACK.Add(1);
BACK.Add(1);
BACK.Add(1);
List<int> FRONT = new List<int>();
FRONT.Add(0);
FRONT.Add(0);
FRONT.Add(0);
FRONT.Add(5);

double[,] np_verts = new double [NMax,2];
double[,] np_edges = new double [NMax,4];



A = 1;
# ---------- c_script: C# additional code ----------
class DifferentialLine(int Segments) {

  void __init__(self, long nmax, double zonewidth, double nearl, double farl, long procs){
    //segments.Segments.__init__(self, nmax, zonewidth);
    // nearl is the closest comfortable distance between two vertices.
    // farl is the distance beyond which disconnected vertices will ignore one another
    self.nearl = nearl;
    self.farl = farl;
    self.procs = procs;
  }
}
# ---------- end c_script ----------
panel = Panel(c_script.out)
panel_2 = Panel(c_script.A)
