# Grasshopper definition canopy.gh (Grasshopper 1.0.7)

md_slider = MDSlider(
    SliderMode=0,
    slider_value=Point(0.5527287499, 0.5824508331, 0.5),
    x_domain=Domain(-1, 1),
    y_domain=Domain(-1, 1),
    z_domain=Domain(0, 1))
srf = Surface(<surface referenced from the Rhino model>)
area = Area(Geometry=srf)  # -> Area, Centroid
Z = UnitZ(Factor=1)
line = LineSDL(Start=area.Centroid, Direction=Z, Length=Slider(6.5, range=0..10))
extrude = ExtrudeLinear(Profile=srf, OrientationP=PlaneXY(0, 0, 0), Axis=line)
popgeo = PopulateGeometry(Geometry=extrude, Count=Slider(1166, range=0..10000), Seed=1)
pt = Point(Point(0, 0, 0))
Z_2 = UnitZ(Factor=1)
del = DelaunayMesh(Points=popgeo, Plane=PlaneXY(0, 0, 0))
pdecon = Deconstruct(Point=md_slider)  # -> XComponent, YComponent, ZComponent
disjoint = DisjointMesh(Mesh=del)
vec = VectorXYZ(XComponent=pdecon.XComponent, YComponent=pdecon.YComponent, ZComponent=Z_2)  # -> Vector, Length
line_2 = LineSDL(Start=area.Centroid, Direction=vec.Vector, Length=Slider(300, range=0..1000))
demesh = DeconstructMesh(Mesh=disjoint)  # -> Vertices, Faces, Colours, Normals
angle = Angle(VectorA=demesh.Normals, VectorB=vec.Vector)  # -> Angle, Reflex
smaller = SmallerThan(FirstNumber=angle.Angle, SecondNumber=Slider(0.25, range=0..1))  # -> SmallerThan, OrEqualTo
dispatch = Dispatch(List=demesh.Faces, DispatchPattern=smaller.SmallerThan)  # -> ListA, ListB
cullf = CullFaces(Mesh=disjoint, Pattern=smaller.SmallerThan)
panel = Panel(dispatch.ListA)
