# Grasshopper definition canopyFinal.gh (Grasshopper 1.0.7)
# plug-ins: Kangaroo2 Components

pt = Point(<point referenced from the Rhino model>)
pt_2 = Point(<point referenced from the Rhino model>)
pt_3 = Point(<point referenced from the Rhino model>)
pline = PolyLine(Vertices=[<geometry referenced from the Rhino model> x3], Closed=True)
triangle = MeshTriangle(CornerA=pt_2, CornerB=pt, CornerC=pt_3)
triremesh = TriRemesh(Geometry=pline, Iterations=25)  # -> Triangulation, Dual, Creases
anchor = Anchor(Point=[pt_2, pt, pt_3], Strength=10000)
demesh = DeconstructMesh(Mesh=triremesh.Triangulation)  # -> Vertices, Faces, Colours, Normals
Z = UnitZ(Factor=1)
multiplication = Multiplication(A=Z, B=Slider(-10, range=-10..10))
edgelengths = EdgeLengths(Mesh=triremesh.Triangulation, LengthFactor=Slider(0.8, range=0..3), Strength=Slider(400, range=0..10000))
load = Load(Point=demesh.Vertices, ForceVector=multiplication, Weighting=1)
number_slider = Slider(1, range=0..1)
solver = Solver(GoalObjects=[load, anchor, edgelengths], Reset=Button(), Threshold=1e-15, Tolerance=0.0001, On=Toggle(True))  # -> I, V, O
clean = CleanTree(RemoveNulls=True, RemoveInvalid=True, RemoveEmpty=True, Tree=solver.O)
clean_2 = CleanTree(RemoveNulls=True, RemoveInvalid=True, RemoveEmpty=True, Tree=solver.V)
