# Grasshopper definition coral.gh (Grasshopper 1.0.7)

number_slider = Slider(12, range=0..100)
box = CenterBox(Base=PlaneXY(0, 0, 0), X=number_slider, Y=number_slider, Z=Slider(23, range=0..100))
popgeo = PopulateGeometry(Geometry=box, Count=Slider(23, range=0..100), Seed=1)
voronoi³ = Voronoi3D(Points=popgeo, Box=box)  # -> Cells, Boundary
wires = BrepWireframe(Brep=voronoi³.Cells, Density=-1)
pipe = Pipe(Curve=wires, Radius=Slider(3, range=1..3), Caps=2)  # -> flatten(Pipe)
sunion = SolidUnion()
join = BrepJoin(Breps=pipe)  # -> Breps, Closed
