# Grasshopper definition deform.gh (Grasshopper 1.0.7)
# plug-ins: Kangaroo2 Components

# ---- group: Start here
# Right click and select one surface
# This sets how fine the mesh is
# This is the distance from the edge before force is applied
# This is how strong the springs are
# This is the force being applied
number_slider = Slider(74, range=0..1000)
fineness_of_mesh = Slider(58, range=0..100)
distance_from_edge = Slider(5.87, range=0..110)
srf = Surface(<surface referenced from the Rhino model>)
number_slider_2 = Slider(5, range=0..10)

# ---- group: then run this
# Click this to reset the solver
# Double click this to run the solver
button = Button()
toggle = BooleanToggle(False)

# ----
mesh_uv = MeshSurface(Surface=srf, UCount=fineness_of_mesh, VCount=fineness_of_mesh, Overhang=True, Equalize=False)
area = Area(Geometry=srf)  # -> Area, Centroid
sqrt = SquareRoot(Value=area.Area)
medges = MeshEdges(Mesh=mesh_uv)  # -> NakedEdges, InteriorEdges, NonManifoldEdges
demesh = DeconstructMesh(Mesh=mesh_uv)  # -> Vertices, Faces, Colours, Normals
Z = UnitZ(Factor=1)
end = EndPoints(Curve=medges.NakedEdges)  # -> Start, End
crv_cp = CurveClosestPoint(Point=demesh.Vertices, Curve=medges.NakedEdges)  # -> Point, Parameter, Distance
neg = Negative(Value=Z)
larger = LargerThan(FirstNumber=crv_cp.Distance, SecondNumber=distance_from_edge)  # -> LargerThan, OrEqualTo
multiplication = Multiplication(A=neg, B=larger.LargerThan)
edgelengths = EdgeLengths(Mesh=mesh_uv, LengthFactor=Slider(0.65, range=0..10), Strength=number_slider)
anchor = Anchor(Point=end.Start, Strength=10000)
load = Load(Point=demesh.Vertices, ForceVector=multiplication, Weighting=number_slider_2)
solver = Solver(GoalObjects=[load, anchor, edgelengths], Reset=button, Threshold=1e-15, Tolerance=0.0001, On=toggle)  # -> I, V, O

# ---- group: output here
# Bake this to output the deformed surface
del = DelaunayMesh(Points=solver.V, Plane=PlaneXY(0, 0, 0))
