# Grasshopper definition drape.gh (Grasshopper 1.0.7)
# plug-ins: Kangaroo2 Components

number_slider = Slider(2, range=0..10)
mesh = Mesh(<mesh referenced from the Rhino model>)
demesh = DeconstructMesh(Mesh=mesh)  # -> Vertices, Faces, Colours, Normals
triremesh = TriRemesh(Geometry=mesh, Iterations=25)  # -> Triangulation, Dual, Creases
Z = UnitZ(Factor=1)
demesh_2 = DeconstructMesh(Mesh=triremesh.Triangulation)  # -> Vertices, Faces, Colours, Normals
neg = Negative(Value=Slider(3, range=0..100))
multiplication = Multiplication(A=Z, B=neg)
cullf = CullFaces(Mesh=triremesh.Triangulation, Pattern=[False, False, True])
anchor = Anchor(Point=demesh.Vertices, Strength=10000)
load = Load(Point=demesh_2.Vertices, ForceVector=multiplication, Weighting=1)
medges = MeshEdges(Mesh=triremesh.Triangulation)  # -> NakedEdges, InteriorEdges, NonManifoldEdges
len = Length(Curve=[medges.NakedEdges, medges.InteriorEdges])
multiplication_2 = Multiplication(A=len, B=Slider(0.81, range=0..1))
length_line = LengthLine(Line=[medges.NakedEdges, medges.InteriorEdges], Length=multiplication_2, Strength=Slider(358, range=0..1000))
solver = Solver(GoalObjects=[load, anchor, length_line], Reset=Button(), Threshold=1e-15, Tolerance=0.0001, On=Toggle(True))  # -> I, V, O
loft_opt = LoftOptions(Closed=False, Adjust=False, Rebuild=0, Refit=0, Type=0)
clean = CleanTree(RemoveNulls=True, RemoveInvalid=True, RemoveEmpty=False, Tree=solver.O)
panel = Panel(solver.V)
del = DelaunayMesh(Points=solver.V, Plane=PlaneXY(0, 0, 0))
