# Grasshopper definition funnel.gh (Grasshopper 1.0.7)
# plug-ins: Kangaroo2 Components

number_slider = Slider(24, range=0..100)
Z = UnitZ(Factor=1)
number_slider_2 = Slider(150, range=-1..150)
pt = Point(Point(0, 0, 0))
pt_2 = Point(Point(0, 0, 0))
vec = VectorXYZ(XComponent=0, YComponent=0, ZComponent=Slider(130, range=0..1000))  # -> Vector, Length
knob = ControlKnob(Decimals=2, Limit=True, Maximum=10, Minimum=0, Range=1, Value=0.75)
move = Move(Geometry=pt, Motion=vec.Vector)  # -> Geometry, Transform
vec_2 = VectorXYZ(XComponent=0, YComponent=0, ZComponent=Slider(150, range=-1..150))  # -> Vector, Length
line = LineSDL(Start=pt, Direction=Z, Length=number_slider)
multiplication = Multiplication(A=knob, B=3.141592654)
move_2 = Move(Geometry=pt_2, Motion=vec_2.Vector)  # -> Geometry, Transform
polygon = Polygon(Plane=move_2.Geometry, Radius=number_slider_2, Segments=6, FilletRadius=0)  # -> Polygon, Length
circle = CircleCNR(Center=pt, Normal=Z, Radius=number_slider)
circle_2 = CircleCNR(Center=move.Geometry, Normal=Z, Radius=Slider(20, range=0..100))
number_slider_3 = Slider(12, range=0..100)
circle_3 = CircleCNR(Center=move_2.Geometry, Normal=Z, Radius=number_slider_2)
multiplication_2 = Multiplication(A=knob, B=6.283185307)
divide = DivideCurve(Curve=circle_2, Count=number_slider_3, Kinks=False)  # -> Points, Tangents, Parameters
divide_2 = DivideCurve(Curve=circle, Count=number_slider_3, Kinks=False)  # -> Points, Tangents, Parameters
rotax = RotateAxis(Geometry=divide.Points, Angle=multiplication, Axis=line)  # -> graft(Geometry), Transform
divide_3 = DivideCurve(Curve=circle_3, Count=number_slider_3, Kinks=False)  # -> graft(Points), Tangents, Parameters
rotax_2 = RotateAxis(Geometry=divide_2.Points, Angle=multiplication_2, Axis=line)  # -> graft(Geometry), Transform
nurbs = NurbsCurve(Vertices=[divide_3.Points, rotax.Geometry, rotax_2.Geometry], Degree=3, Periodic=False)  # -> flatten(Curve), Length, Domain
loft_opt = LoftOptions(Closed=True, Adjust=False, Rebuild=0, Refit=0, Type=0)
loft = Loft(Curves=nurbs.Curve, Options=loft_opt)
area = Area(Geometry=loft)  # -> Area, Centroid
bbox = BoundingBox(Content=loft, Plane=PlaneXY(0, 0, 0))  # -> Box, Box_2
scale = Scale(Geometry=bbox.Box, Center=area.Centroid, Factor=Slider(1.2, range=0..10))  # -> Geometry, Transform
relay = Relay()
popgeo = PopulateGeometry(Geometry=loft, Count=Slider(268, range=0..1000), Seed=1)
voronoi³ = Voronoi3D(Points=popgeo, Box=scale.Geometry)  # -> Cells, Boundary

popgeo_2 = PopulateGeometry(Geometry=relay, Count=Slider(120, range=0..1000), Seed=1)
popgeo_3 = PopulateGeometry(Geometry=relay, Count=Slider(120, range=0..1000), Seed=69)
area_2 = Area(Geometry=relay)  # -> Area, Centroid
cps = ClosestPoints(Point=popgeo_2, Cloud=popgeo_3, Count=Slider(4, range=0..10))  # -> ClosestPoint, CPIndex, Distance
ln = Line(StartPoint=graft(popgeo_2), EndPoint=cps.ClosestPoint)
pull = PullCurve(Curve=ln, Surface=relay)

popgeo_4 = PopulateGeometry(Geometry=loft, Count=Slider(200, range=0..1000), Seed=1)
bbx = BrepBrep(BrepA=loft, BrepB=voronoi³.Cells)  # -> Curves, Points
voronoi³_2 = Voronoi3D(Points=popgeo_4, Box=scale.Geometry)  # -> Cells, Boundary
fit = FitCurve()
divide_4 = DivideCurve(Curve=bbx.Curves, Count=Slider(6, range=0..20), Kinks=False)  # -> Points, Tangents, Parameters
disc = Discontinuity(Curve=bbx.Curves, Level=1)  # -> Points, Parameters
bbx_2 = BrepBrep(BrepA=loft, BrepB=voronoi³_2.Cells)  # -> Curves, Points
disc_2 = Discontinuity(Curve=bbx_2.Curves, Level=1)  # -> Points, Parameters
nurbs_2 = NurbsCurve(Vertices=disc.Points, Degree=3, Periodic=True)  # -> Curve, Length, Domain
avr = Average(Input=disc.Points)
pipe = Pipe(Curve=bbx.Curves, Radius=1, Caps=0)  # disabled
pipe_2 = Pipe(Curve=nurbs.Curve, Radius=1, Caps=0)  # disabled
pull_2 = PullCurve(Curve=nurbs_2.Curve, Surface=loft)
panel = Panel(divide_4.Points)
pipe_3 = Pipe(Curve=bbx_2.Curves, Radius=Slider(0.3, range=0..1), Caps=0)  # disabled
join = JoinCurves(Curves=[bbx_2.Curves, pull_2], Preserve=False)
disc_3 = Discontinuity(Curve=join, Level=1)  # -> Points, Parameters
nurbs_3 = NurbsCurve(Vertices=disc_3.Points, Degree=3, Periodic=True)  # -> Curve, Length, Domain
pull_3 = PullCurve(Curve=nurbs_3.Curve, Surface=loft)
srfsplit = SurfaceSplit(Surface=loft, Curves=flatten(pull_3))
area_3 = Area(Geometry=srfsplit)  # -> Area, Centroid
sort = SortList(Keys=area_3.Area, ValuesA=srfsplit)  # -> Keys, ValuesA
item = ListItem(List=reverse(sort.ValuesA), Index=Slider(0, range=0..164), Wrap=True)
srf = Surface(item)
mesh = MeshBrep(
    Brep=srfsplit,
    Settings={GridMaxCount=0, GridMinCount=16, JaggedSeams=False, MaxEdgeLength=0, MinEdgeLength=0.0001, MinTolerance=0, Refine=True, RefineAngle=0, RelativeTolerance=0.65, SimplePlanes=True, Tolerance=0})
tri = Triangulate(Mesh=mesh)  # -> Mesh, Count
medges = MeshEdges(Mesh=tri.Mesh)  # -> NakedEdges, InteriorEdges, NonManifoldEdges
demesh = DeconstructMesh(Mesh=tri.Mesh)  # -> Vertices, Faces, Colours, Normals
divide_5 = DivideCurve(Curve=medges.NakedEdges, Count=Slider(3, range=0..10), Kinks=False)  # -> Points, Tangents, Parameters
neg = Negative(Value=demesh.Normals)
anchor = Anchor(Point=divide_5.Points, Strength=10000)
load = Load(Point=demesh.Vertices, ForceVector=neg, Weighting=Slider(20, range=0..110))
show = Show(G=tri.Mesh)
edgelengths = EdgeLengths(Mesh=tri.Mesh, LengthFactor=1, Strength=Slider(50, range=0..1000))
solver = Solver(GoalObjects=[anchor, load, show, edgelengths], Reset=Button(), Threshold=1e-15, Tolerance=0.0001, On=Toggle(False))  # -> I, V, O
clean = CleanTree(RemoveNulls=True, RemoveInvalid=True, RemoveEmpty=False, Tree=solver.O)
bang = ExplodeTree(Data=clean)  # -> Branch0, Branch1
mesh_2 = Mesh(bang.Branch0)
