# Grasshopper definition funnelledFinal.gh (Grasshopper 1.0.7)
# plug-ins: Kangaroo2 Components

vec = VectorXYZ(XComponent=0, YComponent=0, ZComponent=Slider(150, range=0..200))  # -> Vector, Length
vec_2 = VectorXYZ(XComponent=0, YComponent=0, ZComponent=Slider(139.8, range=0..200))  # -> Vector, Length
Z = UnitZ(Factor=1)
vec_3 = VectorXYZ(XComponent=0, YComponent=0, ZComponent=Slider(85.9, range=0..200))  # -> Vector, Length
pt = Point(Point(0, 0, 0))
vec_4 = VectorXYZ(XComponent=0, YComponent=0, ZComponent=Slider(36, range=0..200))  # -> Vector, Length
move = Move(Geometry=pt, Motion=vec.Vector)  # -> Geometry, Transform
move_2 = Move(Geometry=pt, Motion=vec_2.Vector)  # -> Geometry, Transform
move_3 = Move(Geometry=pt, Motion=vec_3.Vector)  # -> Geometry, Transform
move_4 = Move(Geometry=pt, Motion=vec_4.Vector)  # -> Geometry, Transform
waist = CircleCNR(Center=move_3.Geometry, Normal=Z, Radius=Slider(17, range=0..100))
line = LineSDL(Start=pt, Direction=Z, Length=Slider(1, range=0..1))
base = CircleCNR(Center=pt, Normal=Z, Radius=Slider(44, range=0..100))
waist_2 = CircleCNR(Center=move_4.Geometry, Normal=Z, Radius=Slider(10, range=0..100))
number_slider = Slider(12, range=0..100)
divide = DivideCurve(Curve=waist, Count=number_slider, Kinks=False)  # -> Points, Tangents, Parameters
top = Polygon(Plane=move.Geometry, Radius=Slider(100, range=0..1000), Segments=Slider(5, range=0..10), FilletRadius=0)  # -> Polygon, Length
upper = CircleCNR(Center=move_2.Geometry, Normal=Z, Radius=Slider(30, range=0..100))
divide_2 = DivideCurve(Curve=waist_2, Count=number_slider, Kinks=False)  # -> Points, Tangents, Parameters
divide_3 = DivideCurve(Curve=base, Count=number_slider, Kinks=False)  # -> Points, Tangents, Parameters
knob = ControlKnob(Decimals=2, Limit=True, Maximum=10, Minimum=0, Range=1, Value=0.5)
multiplication = Multiplication(A=knob, B=3.141592654)
multiplication_2 = Multiplication(A=knob, B=4.71238898)
multiplication_3 = Multiplication(A=knob, B=6.283185307)
rotax = RotateAxis(Geometry=divide_3.Points, Angle=multiplication_3, Axis=line)  # -> graft(Geometry), Transform
rotax_2 = RotateAxis(Geometry=divide.Points, Angle=multiplication, Axis=line)  # -> graft(Geometry), Transform
divide_4 = DivideCurve(Curve=upper, Count=number_slider, Kinks=False)  # -> graft(Points), Tangents, Parameters
divide_5 = DivideCurve(Curve=top.Polygon, Count=number_slider, Kinks=False)  # -> graft(Points), Tangents, Parameters
rotax_3 = RotateAxis(Geometry=divide_2.Points, Angle=multiplication_2, Axis=line)  # -> graft(Geometry), Transform
number_slider_2 = Slider(0, range=0..100)
nurbs = NurbsCurve(
    Vertices=[rotax.Geometry, rotax_3.Geometry, rotax_2.Geometry, divide_4.Points, divide_5.Points],
    Degree=3,
    Periodic=False)  # -> Curve, Length, Domain
pt_2 = ConstructPoint(XCoordinate=number_slider_2, YCoordinate=number_slider_2, ZCoordinate=Slider(126, range=-1..150))
loft_opt = LoftOptions(Closed=True, Adjust=False, Rebuild=0, Refit=0, Type=0)
pl = PlaneNormal(Origin=pt_2, ZAxis=Vector(0, 0, 1))
loft = Loft(Curves=flatten(nurbs.Curve), Options=loft_opt)
sec = BrepPlane(Brep=loft, Plane=pl)  # -> Curves, Points
boundary = BoundarySurfaces(Edges=base)  # disabled
boundary_2 = BoundarySurfaces(Edges=top.Polygon)  # disabled
split = SplitBrep(Brep=loft, Cutter=sec.Curves)
dispatch = Dispatch(List=split, DispatchPattern=[True, False])  # -> ListA, ListB
join = BrepJoin(Breps=[boundary, loft, boundary_2])  # -> Breps, Closed; disabled
popgeo = PopulateGeometry(Geometry=dispatch.ListA, Count=Slider(11, range=0..5000), Seed=69)
popgeo_2 = PopulateGeometry(Geometry=dispatch.ListB, Count=Slider(44, range=0..5000), Seed=69)
mesh = MeshBrep(Settings={GridMaxCount=0, GridMinCount=16, JaggedSeams=False, MaxEdgeLength=0, MinEdgeLength=0.0001, MinTolerance=0, Refine=True, RefineAngle=0, RelativeTolerance=0.65, SimplePlanes=True, Tolerance=0})  # disabled
voronoi³ = Voronoi3D(Points=[popgeo, popgeo_2])  # -> Cells, Boundary
offset = OffsetSurface(Surface=loft, Distance=Slider(4, range=0..10), Retrim=True)
bbx = BrepBrep(BrepA=offset, BrepB=voronoi³.Cells)  # -> Curves, Points
disc = Discontinuity(Curve=bbx.Curves, Level=1)  # -> Points, Parameters
nurbs_2 = NurbsCurve(Vertices=disc.Points, Degree=3, Periodic=True)  # -> Curve, Length, Domain
avr = Average(Input=disc.Points)
scale = Scale(Geometry=nurbs_2.Curve, Center=avr, Factor=Slider(0.9, range=0..1))  # -> Geometry, Transform
pull = PullCurve(Curve=scale.Geometry, Surface=offset)

# ---- group: Inflate
srfsplit = SurfaceSplit(Surface=offset, Curves=flatten(pull))
join_2 = BrepJoin(Breps=srfsplit)  # -> Breps, Closed
item = ListItem(List=srfsplit, Index=Slider(48, range=0..63), Wrap=True)
mesh_2 = MeshBrep(
    Brep=join_2.Breps,
    Settings={GridMaxCount=0, GridMinCount=16, JaggedSeams=False, MaxEdgeLength=0, MinEdgeLength=0.0001, MinTolerance=0, Refine=True, RefineAngle=0, RelativeTolerance=0.65, SimplePlanes=True, Tolerance=0})
mesh_3 = MeshBrep(
    Brep=item,
    Settings={GridMaxCount=0, GridMinCount=16, JaggedSeams=False, MaxEdgeLength=0, MinEdgeLength=0.0001, MinTolerance=0, Refine=True, RefineAngle=0, RelativeTolerance=0.65, SimplePlanes=True, Tolerance=0})
demesh = DeconstructMesh(Mesh=mesh_2)  # -> Vertices, Faces, Colours, Normals
demesh_2 = DeconstructMesh(Mesh=mesh_3)  # -> Vertices, Faces, Colours, Normals
meshcp = MeshClosestPoint(Point=flatten(demesh_2.Vertices), Mesh=mesh_2)  # -> Point, Index, Parameter; disabled
edgelengths = EdgeLengths(Mesh=mesh_2, LengthFactor=Slider(1, range=0..1), Strength=Slider(6, range=0..100))
show = Show(G=mesh_2)
load = Load(Point=demesh.Vertices, ForceVector=demesh.Normals, Weighting=Slider(1.58, range=-3..3))
anchor = Anchor(Point=demesh_2.Vertices, Strength=1e+10)
bouncysolver = BouncySolver(
    GoalObjects=[anchor, edgelengths, show, load],
    Reset=Button(),
    Threshold=1e-15,
    Tolerance=0.0001,
    Damping=0.99,
    Iterations=10,
    On=Toggle(False))  # -> I, V, O
mesh_4 = Mesh(bouncysolver.O)

# ----
edgelengths_2 = EdgeLengths(Mesh=mesh_2, LengthFactor=Slider(1, range=0..2), Strength=Slider(6, range=0..100))
load_2 = Load(Point=demesh.Vertices, ForceVector=demesh.Normals, Weighting=Slider(-10, range=-10..3))
bouncysolver_2 = BouncySolver(
    GoalObjects=[anchor, show, load_2, edgelengths_2],
    Reset=Button(),
    Threshold=1e-15,
    Tolerance=0.0001,
    Damping=0.99,
    Iterations=10,
    On=Toggle(False))  # -> I, V, O
