# Grasshopper definition leaves.gh (Grasshopper 1.0.7)

number_slider = Slider(66, range=0..100)
pt = Point(Point(0, 0, 0))
vec = VectorXYZ(XComponent=Slider(0, range=0..1), YComponent=Slider(1, range=0..1), ZComponent=Slider(0, range=0..1))  # -> Vector, Length
multiplication = Multiplication(A=number_slider, B=0.5)
line = LineSDL(Start=pt, Direction=vec.Vector, Length=number_slider)
knob = ControlKnob(Decimals=2, Limit=True, Maximum=10, Minimum=0, Range=1, Value=0.11)
relay = Relay()
number_slider_2 = Slider(5, range=0..10)
cluster = Cluster(angle=knob, V=vec.Vector, C=line, L=multiplication, N=number_slider_2)  # -> _2nd_lines, curve, R
cluster_2 = Cluster(angle=knob, V=cluster._2nd_lines, C=cluster.curve, L=cluster.R, N=number_slider_2)  # -> _2nd_lines, curve, R
cluster_3 = Cluster(angle=knob, V=cluster_2._2nd_lines, C=cluster_2.curve, L=cluster_2.R, N=number_slider_2)  # -> _2nd_lines, curve, R
neg = Negative(Value=knob)
repeat = RepeatData(Data=[knob, neg], Length=number_slider_2)
Z = UnitZ(Factor=1)
pi = Pi(Factor=repeat)
divide = DivideCurve(Curve=cluster_3.curve, Count=number_slider_2, Kinks=False)  # -> Points, Tangents, Parameters
vrot = Rotate(Vector=cluster_3._2nd_lines, Axis=Z, Angle=pi)
pi_2 = Pi(Factor=Slider(53, range=0..100))
line_2 = LineSDL(Start=divide.Points, Direction=vrot, Length=cluster_3.R)
rotax = RotateAxis(Geometry=line_2, Angle=pi_2, Axis=Z)  # -> Geometry, Transform
vrot_2 = Rotate(Vector=vrot, Axis=Z, Angle=pi_2)
len = Length(Curve=line_2)
midpt = CurveMiddle(Curve=line_2)
multiplication_2 = Multiplication(A=len, B=0.25)
line_3 = LineSDL(Start=midpt, Direction=vrot_2, Length=multiplication_2)
mirror = MirrorCurve(Geometry=line_3, Curve=line_2, Tangent=True)
end = EndPoints(Curve=line_2)  # -> Start, End
end_2 = EndPoints(Curve=line_3)  # -> Start, End
end_3 = EndPoints(Curve=mirror)  # -> Start, End
srf4pt = _4PointSurface(CornerA=end.Start, CornerB=end_2.End, CornerC=end.End, CornerD=end_3.End)

# ==== cluster Cluster
V = ClusterInput()
angle = ClusterInput()
C = ClusterInput()
N = ClusterInput()
division = Division(A=N, B=2)
multiplication = Multiplication(A=angle, B=3.141592654)
divide = DivideCurve(Curve=C, Count=N, Kinks=False)  # -> Points, Tangents, Parameters
neg = Negative(Value=multiplication)
Z = UnitZ(Factor=1)
dup = DuplicateData(Data=[multiplication, neg], Number=division, Order=True)
vrot = Rotate(Vector=V, Axis=Z, Angle=dup)
L = ClusterInput()
multiplication_2 = Multiplication(A=L, B=0.5)
line = LineSDL(Start=divide.Points, Direction=vrot, Length=L)
_2nd_lines = ClusterOutput(vrot)
curve = ClusterOutput(line)
R = ClusterOutput(multiplication_2)
