# Grasshopper definition organism.gh (Grasshopper 1.0.7)
# plug-ins: Kangaroo2 Components

srf = Surface(<surface referenced from the Rhino model>)
number_slider = Slider(4, range=0..10)
number_slider_2 = Slider(3, range=0..10)
number_slider_3 = Slider(69, range=0..100)
mesh = MeshBrep(
    Brep=srf,
    Settings={GridMaxCount=0, GridMinCount=16, JaggedSeams=False, MaxEdgeLength=0, MinEdgeLength=0.0001, MinTolerance=0, Refine=True, RefineAngle=0, RelativeTolerance=0.65, SimplePlanes=True, Tolerance=0})
area = Area(Geometry=mesh)  # -> Area, Centroid
scale_nu = ScaleNU(Geometry=mesh, Plane=area.Centroid, ScaleX=number_slider_2, ScaleY=number_slider_2, ScaleZ=number_slider)  # -> Geometry, Transform
scale_nu_2 = ScaleNU(Geometry=srf, Plane=area.Centroid, ScaleX=number_slider_2, ScaleY=number_slider_2, ScaleZ=number_slider)  # -> Geometry, Transform
popgeo = PopulateGeometry(Geometry=scale_nu.Geometry, Count=Slider(140, range=0..1000), Seed=number_slider_3)
facen = FaceNormals(Mesh=scale_nu.Geometry)  # -> Centers, Normals
popgeo_2 = PopulateGeometry(Geometry=scale_nu.Geometry, Count=Slider(420, range=0..1000), Seed=number_slider_3)
bbox = BoundingBox(Content=scale_nu.Geometry, Plane=PlaneXY(0, 0, 0))  # -> Box, Box_2
subdmesh = SubDFromMesh(Mesh=scale_nu.Geometry, Creases=1, Corners=1, Interpolate=False)
cp = ClosestPoint(Point=popgeo, Cloud=facen.Centers)  # -> ClosestPoint, CPIndex, Distance
item = ListItem(List=facen.Normals, Index=cp.CPIndex, Wrap=True)
circle = CircleCNR(Center=popgeo, Normal=item, Radius=Slider(4, range=0..100))
inverse = InverseTransform(Transform=scale_nu.Transform)
pull = PullPoint(Point=popgeo_2, Geometry=circle, ClosestOnly=True)  # -> ClosestPoint, Distance
voronoi³ = Voronoi3D(Points=pull.ClosestPoint, Box=bbox.Box)  # -> Cells, Boundary
bbx = BrepBrep(BrepA=voronoi³.Cells, BrepB=subdmesh)  # -> Curves, Points
disc = Discontinuity(Curve=bbx.Curves, Level=1)  # -> Points, Parameters
panel = Panel(inverse)
avr = Average(Input=disc.Points)
nurbs = NurbsCurve(Vertices=disc.Points, Degree=3, Periodic=True)  # -> Curve, Length, Domain
cp_2 = ClosestPoint(Point=avr, Cloud=facen.Centers)  # -> ClosestPoint, CPIndex, Distance
item_2 = ListItem(List=facen.Normals, Index=cp_2.CPIndex, Wrap=True)
scale = Scale(Geometry=nurbs.Curve, Center=avr, Factor=Slider(0.8, range=0..1))  # -> Geometry, Transform
neg = Negative(Value=item_2)
pull_2 = PullCurve(Curve=scale.Geometry, Surface=scale_nu_2.Geometry)
triremesh = TriRemesh(Geometry=scale_nu.Geometry, Iterations=25)  # -> Triangulation, Dual, Creases
caves_depth = LineSDL(Start=avr, Direction=neg, Length=Slider(12.6, range=0..110))
divide = DivideCurve(Curve=pull_2, Count=Slider(36, range=0..100), Kinks=False)  # -> Points, Tangents, Parameters
end = EndPoints(Curve=caves_depth)  # -> Start, End
arc = ArcSED(Start=divide.Points, End=end.End, Direction=neg)  # -> Arc, Plane, Radius
loft_opt = LoftOptions(Closed=True, Adjust=False, Rebuild=0, Refit=0, Type=0)
loft = Loft(Curves=arc.Arc, Options=loft_opt)
mesh_2 = MeshBrep(
    Brep=loft,
    Settings={GridMaxCount=0, GridMinCount=16, JaggedSeams=False, MaxEdgeLength=0, MinEdgeLength=0.0001, MinTolerance=0, Refine=True, RefineAngle=0, RelativeTolerance=0.65, SimplePlanes=True, Tolerance=0})
transform = Transform(Geometry=[loft, pull_2], Transform=inverse)
msplit = MeshSplit(Mesh=triremesh.Triangulation, Splitters=flatten(mesh_2))
simplify = SimplifyTree(Tree=msplit, Front=False)
item_3 = ListItem(List=simplify, Index=Slider(0, range=0..131), Wrap=True)
mesh_3 = Mesh(item_3)
panel_2 = Panel(simplify)
