# Grasshopper definition organism2.gh (Grasshopper 1.0.7)
# plug-ins: Kangaroo2 Components

number_slider = Slider(3, range=0..10)
srf = Surface(<surface referenced from the Rhino model>)
mesh = Mesh(<mesh referenced from the Rhino model>)
mesh_2 = Mesh(<mesh referenced from the Rhino model>)
mesh_3 = Mesh(<mesh referenced from the Rhino model>)
brep = Brep(<brep referenced from the Rhino model>)
number_slider_2 = Slider(3, range=0..10)
mesh_4 = MeshBrep(
    Brep=srf,
    Settings={GridMaxCount=0, GridMinCount=16, JaggedSeams=False, MaxEdgeLength=0, MinEdgeLength=0.0001, MinTolerance=0, Refine=True, RefineAngle=0, RelativeTolerance=0.65, SimplePlanes=True, Tolerance=0})
area = Area(Geometry=mesh_4)  # -> Area, Centroid
scale_nu = ScaleNU(Geometry=mesh_4, Plane=area.Centroid, ScaleX=number_slider_2, ScaleY=number_slider_2, ScaleZ=Slider(5, range=0..10))  # -> Geometry, Transform
inverse = InverseTransform(Transform=scale_nu.Transform)
bbox = BoundingBox(Content=scale_nu.Geometry, Plane=PlaneXY(0, 0, 0))  # -> Box, Box_2
subdmesh = SubDFromMesh(Mesh=scale_nu.Geometry, Creases=1, Corners=1, Interpolate=False)
panel = Panel(inverse)
number_slider_3 = Slider(8, range=0..110)
number_slider_4 = Slider(12, range=0..110)
addition = Addition(A=number_slider_3, B=number_slider_4)
triremesh = TriRemesh(Geometry=scale_nu.Geometry, Iterations=25)  # -> Triangulation, Dual, Creases
facen = FaceNormals(Mesh=triremesh.Dual)  # -> Centers, Normals
popgeo = PopulateGeometry(Geometry=triremesh.Dual, Count=Slider(160, range=0..1000), Seed=Slider(69, range=0..100))
cp = ClosestPoint(Point=popgeo, Cloud=facen.Centers)  # -> ClosestPoint, CPIndex, Distance
item = ListItem(List=facen.Normals, Index=cp.CPIndex, Wrap=True)
circle = CircleCNR(Center=popgeo, Normal=item, Radius=Slider(11, range=0..100))
popgeo_2 = PopulateGeometry(Geometry=triremesh.Dual, Count=Slider(420, range=0..1000), Seed=Slider(69, range=0..100))
pull = PullPoint(Point=popgeo_2, Geometry=circle, ClosestOnly=True)  # -> ClosestPoint, Distance
facen_2 = FaceNormals(Mesh=triremesh.Dual)  # -> Centers, Normals
voronoi³ = Voronoi3D(Points=pull.ClosestPoint, Box=bbox.Box)  # -> Cells, Boundary
bbx = BrepBrep(BrepA=voronoi³.Cells, BrepB=subdmesh)  # -> Curves, Points
disc = Discontinuity(Curve=bbx.Curves, Level=1)  # -> Points, Parameters
avr = Average(Input=disc.Points)
avr_2 = Average(Input=disc.Points)
pline = PolyLine(Vertices=disc.Points, Closed=True)
nurbs = NurbsCurve(Vertices=disc.Points, Degree=3, Periodic=True)  # -> Curve, Length, Domain
cp_2 = ClosestPoint(Point=avr_2, Cloud=facen_2.Centers)  # -> ClosestPoint, CPIndex, Distance
scale = Scale(Geometry=pline, Center=avr, Factor=Slider(0.77, range=0..1))  # -> Geometry, Transform
item_2 = ListItem(List=facen_2.Normals, Index=cp_2.CPIndex, Wrap=True)
scale_2 = Scale(Geometry=nurbs.Curve, Center=avr_2, Factor=Slider(0.75, range=0..1))  # -> Geometry, Transform
neg = Negative(Value=item_2)
line = LineSDL(Start=avr_2, Direction=neg, Length=number_slider_3)
line_2 = LineSDL(Start=avr_2, Direction=item_2, Length=number_slider_4)
reb = RebuildCurve(Curve=scale.Geometry, Degree=Slider(3, range=0..10), Count=5, Tangents=False)
divide = DivideCurve(Curve=scale_2.Geometry, Count=Slider(12, range=0..100), Kinks=False)  # -> Points, Tangents, Parameters
end = EndPoints(Curve=line)  # -> Start, End
end_2 = EndPoints(Curve=line_2)  # -> Start, End
demesh = DeconstructMesh(Mesh=triremesh.Dual)  # -> Vertices, Faces, Colours, Normals
medges = MeshEdges(Mesh=triremesh.Dual)  # -> NakedEdges, InteriorEdges, NonManifoldEdges
multiplication = Multiplication(A=demesh.Normals, B=Slider(12, range=0..100))
len = Length(Curve=medges.NakedEdges)
number_slider_5 = Slider(330, range=0..1000)
multiplication_2 = Multiplication(A=len, B=Slider(0.8, range=0..1))
arc = ArcSED(Start=divide.Points, End=end_2.End, Direction=item_2)  # -> Arc, Plane, Radius
arc_2 = ArcSED(Start=divide.Points, End=end.End, Direction=neg)  # -> Arc, Plane, Radius
join = JoinCurves(Curves=[arc_2.Arc, arc.Arc], Preserve=False)
cp_3 = ClosestPoint(Point=divide.Points, Cloud=demesh.Vertices)  # -> ClosestPoint, CPIndex, Distance
reb_2 = RebuildCurve(Curve=join, Count=10, Tangents=False)
loft_opt = LoftOptions(Closed=True, Adjust=False, Rebuild=5, Refit=0.1, Type=0)
loft_opt_2 = LoftOptions(Closed=True, Adjust=True, Rebuild=0, Refit=0.1, Type=3)
loft = Loft(Curves=arc.Arc, Options=loft_opt_2)
loft_2 = Loft(Curves=arc_2.Arc, Options=loft_opt)
mjoin = MeshJoin(Meshes=[loft_2, loft])
join_2 = BrepJoin(Breps=[loft_2, loft])  # -> Breps, Closed
tri = Triangulate(Mesh=mjoin)  # -> Mesh, Count
msplit = MeshSplit(Mesh=triremesh.Triangulation, Splitters=flatten(tri.Mesh))
knob = ControlKnob(Decimals=0, Limit=True, Maximum=10, Minimum=0, Range=1001, Value=0)
simplify = SimplifyTree(Tree=msplit, Front=False)
item_3 = ListItem(List=simplify, Index=knob, Wrap=True)
scale_nu_2 = ScaleNU(Geometry=srf, Plane=area.Centroid, ScaleX=number_slider, ScaleY=number_slider, ScaleZ=Slider(5, range=0..10))  # -> Geometry, Transform
splitmul = SplitBrepMultiple(Brep=scale_nu_2.Geometry, Cutters=flatten(join_2.Breps))
brep_2 = Brep(item_3)
mesh_5 = MeshBrep(
    Brep=loft_2,
    Settings={GridMaxCount=0, GridMinCount=16, JaggedSeams=False, MaxEdgeLength=0, MinEdgeLength=0.0001, MinTolerance=0, Refine=True, RefineAngle=0, RelativeTolerance=0.65, SimplePlanes=True, Tolerance=0})
mesh_6 = Mesh(item_3)
pull_2 = PullCurve(Curve=scale_2.Geometry, Surface=scale_nu_2.Geometry)  # -> flatten(Curve)
join_3 = BrepJoin(Breps=[loft_2, brep_2])  # -> Breps, Closed
mjoin_2 = MeshJoin(Meshes=[mesh_5, mesh_6])
brep_3 = Brep(scale_nu_2.Geometry)
panel_2 = Panel(simplify)
transform = Transform(Geometry=[loft_2, pull_2], Transform=inverse)
