# Grasshopper definition peñaTensegrity.gh (Grasshopper 1.0.7)
# plug-ins: Kangaroo2 Components

number_slider = Slider(10, range=0..10)
python = GhPythonScript(x=Slider(0, range=0..100), y=Slider(5, range=0..30), z=Slider(15, range=0..30), u=Slider(20, range=0..30))  # -> out, floorPts, struts, membranes
# ---------- python: Python ----------
import rhinoscriptsyntax as rs
from Rhino import Geometry

#script to draw Diana Pena's tensegrity membrane

#draw co-ords
Z0 = x
Z1 = y
Z2 = z
Z3 = u

#draw nodes
p1 = rs.AddPoint([-4.7,8.22,Z0])
#p1 = Geometry.Point3d(-4.7,8.22,Z0)
p2 = rs.AddPoint([4.7,8.22,Z0])
#p2 = Geometry.Point3d(4.7,8.22,Z0)
p3 = rs.AddPoint([9.5,0,Z0])
p4 = rs.AddPoint([4.7,-8.22,Z0])
p5 = rs.AddPoint([-4.7,-8.22,Z0])
p6 = rs.AddPoint([-9.5,0,Z0])
p7 = rs.AddPoint([-3.33,12.04,Z1])
p8 = rs.AddPoint([8.7,8.7,Z1])
p9 = rs.AddPoint([12,-3.13,Z1])
p10 = rs.AddPoint([3.33,-12.04,Z1])
p11 = rs.AddPoint([-8.7,-8.7,Z1])
p12 = rs.AddPoint([-12,3.13,Z1])
p13 = rs.AddPoint([3.33,12.04,Z2])
p14 = rs.AddPoint([12,3.15,Z2])
p15 = rs.AddPoint([8.7,-8.7,Z2])
p16 = rs.AddPoint([-3.33,-12.04,Z2])
p17 = rs.AddPoint([-12,-3.15,Z2])
p18 = rs.AddPoint([-8.7,8.7,Z2])
p19 = rs.AddPoint([0,9.5,Z3])
p20 = rs.AddPoint([8.22,4.7,Z3])
p21 = rs.AddPoint([8.22,-4.7,Z3])
p22 = rs.AddPoint([0,-9.5,Z3])
p23 = rs.AddPoint([-8.22,-4.7,Z3])
p24 = rs.AddPoint([-8.22,4.7,Z3])

#points = [p1,p2,p3,p4,p5,p6,p7,p8,p9,p10,p11,p12,p13,p14,p15,p16,p17,p18,p19,p20,p21,p22,p23,p24]
floorPts = [p1,p2,p3,p4,p5,p6]

l1 = rs.AddLine(p1,p17)
l2 = rs.AddLine(p2,p18)
l3 = rs.AddLine(p3,p13)
l4 = rs.AddLine(p4,p14)
l5 = rs.AddLine(p5,p15)
l6 = rs.AddLine(p6,p16)
l7 = rs.AddLine(p7,p20)
l8 = rs.AddLine(p8,p21)
l9 = rs.AddLine(p9,p22)
l10 = rs.AddLine(p10,p23)
l11 = rs.AddLine(p11,p24)
l12 = rs.AddLine(p12,p19)

struts = [l1,l2,l3,l4,l5,l6,l7,l8,l9,l10,l11,l12]


rs.AddPipe(l1,[0.0,0.0],[0.025,0.025])
rs.AddPipe(l2,[0.0,0.0],[0.025,0.025])
rs.AddPipe(l3,[0.0,0.0],[0.025,0.025])
rs.AddPipe(l4,[0.0,0.0],[0.025,0.025])
rs.AddPipe(l5,[0.0,0.0],[0.025,0.025])
rs.AddPipe(l6,[0.0,0.0],[0.025,0.025])
rs.AddPipe(l7,[0.0,0.0],[0.025,0.025])
rs.AddPipe(l8,[0.0,0.0],[0.025,0.025])
rs.AddPipe(l9,[0.0,0.0],[0.025,0.025])
rs.AddPipe(l10,[0.0,0.0],[0.025,0.025])
rs.AddPipe(l11,[0.0,0.0],[0.025,0.025])
rs.AddPipe(l12,[0.0,0.0],[0.025,0.025])

#membranes = []

membranes = [rs.AddSrfPt([p1,p12,p17,p6]),
    rs.AddSrfPt([p2,p7,p18,p1]),
    rs.AddSrfPt([p3,p8,p13,p2]),
    rs.AddSrfPt([p4,p9,p14,p3]),
    rs.AddSrfPt([p5,p10,p15,p4]),
    rs.AddSrfPt([p6,p11,p16,p5]),
    rs.AddSrfPt([p12,p18,p19,p24]),
    rs.AddSrfPt([p7,p13,p20,p19]),
    rs.AddSrfPt([p8,p14,p21,p20]),
    rs.AddSrfPt([p9,p15,p22,p21]),
    rs.AddSrfPt([p10,p16,p23,p22]),
    rs.AddSrfPt([p11,p17,p24,p23])]
# ---------- end python ----------
anchorxyz = AnchorXYZ(Point=python.floorPts, X=Toggle(False), Y=Toggle(False), Z=Toggle(True), Strength=1000)
mesh_uv = MeshSurface(Surface=python.membranes, UCount=number_slider, VCount=number_slider, Overhang=True, Equalize=False)
Z = UnitZ(Factor=1)
mc = MeshCorners(Mesh=mesh_uv, Angle=2.35619449)
show = Show(G=[mesh_uv, python.struts])
pl = PlasticLength(Line=python.struts, Limit=1, Strength=Slider(91, range=0..100))
multiplication = Multiplication(A=Z, B=-1)
edgelengths = EdgeLengths(Mesh=mesh_uv, LengthFactor=Slider(0.7, range=0..1), Strength=Slider(62, range=0..100))
load = Load(Point=mc, ForceVector=multiplication, Weighting=1)
bouncysolver = BouncySolver(
    GoalObjects=flatten([show, edgelengths, pl, load, anchorxyz]),
    Reset=Button(),
    Threshold=1e-15,
    Tolerance=0.0001,
    Damping=0.99,
    Iterations=10,
    On=Toggle(True))  # -> I, V, O
