# Grasshopper definition sag.gh (Grasshopper 1.0.7)
# plug-ins: Kangaroo2 Components

number_slider = Slider(84, range=0..100)
srf = Surface(<surface referenced from the Rhino model>)
number_slider_2 = Slider(-0.1, range=-10..10)
mesh_uv = MeshSurface(Surface=srf, UCount=number_slider, VCount=number_slider, Overhang=True, Equalize=False)
tri = Triangulate(Mesh=mesh_uv)  # -> Mesh, Count
demesh = DeconstructMesh(Mesh=tri.Mesh)  # -> Vertices, Faces, Colours, Normals
medges = MeshEdges(Mesh=tri.Mesh)  # -> NakedEdges, InteriorEdges, NonManifoldEdges
Z = UnitZ(Factor=1)
edgelengths = EdgeLengths(Mesh=tri.Mesh, LengthFactor=1, Strength=Slider(2, range=0..10))
end = EndPoints(Curve=medges.NakedEdges)  # -> Start, End
neg = Negative(Value=Z)
load = Load(Point=demesh.Vertices, ForceVector=neg, Weighting=Slider(0.039, range=0..0.1))
anchor = Anchor(Point=end.Start, Strength=10000)
solver = Solver(GoalObjects=[anchor, load, edgelengths], Reset=Button(), Threshold=1e-15, Tolerance=0.0001, On=Toggle(True))  # -> I, V, O
del = DelaunayMesh(Points=solver.V, Plane=PlaneXY(0, 0, 0))
