# Grasshopper definition spindle.gh (Grasshopper 1.0.7)
# plug-ins: Kangaroo2 Components, Weaverbird

crv = Curve(<curve referenced from the Rhino model>)
arrpolar = PolarArray(
    Geometry=<curve referenced from the Rhino model>,
    Plane=PlaneXY(0, 0, 0),
    Count=Slider(5, range=0..10),
    Angle=6.283185307)  # -> Geometry, Transform
arrpolar_2 = PolarArray(Geometry=flatten(crv), Plane=PlaneXY(0, 0, 0), Count=6, Angle=6.283185307)  # -> flatten(Geometry), Transform
divide = DivideCurve(Curve=arrpolar_2.Geometry, Count=Slider(70, range=0..100), Kinks=False)  # -> Points, Tangents, Parameters
loft_opt = LoftOptions(Closed=True, Adjust=False, Rebuild=0, Refit=0, Type=3)
loft = Loft(Options=loft_opt)
loft_2 = Loft(Options=loft_opt)
loft_3 = Loft(Curves=arrpolar_2.Geometry, Options=loft_opt)
bang = ExplodeTree(Data=divide.Points)  # -> Branch0, Branch1, Branch2, Branch3, Branch4, Branch5, Branch6, Branch7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
triremesh = TriRemesh(Geometry=[loft_2, loft, loft_3], Iterations=25)  # -> Triangulation, Dual, Creases
neg = Negative(Value=Slider(40, range=0..130))
refine = Refine(Mesh=triremesh.Triangulation, Level=1)
demesh = DeconstructMesh(Mesh=refine)  # -> Vertices, Faces, Colours, Normals
bang_2 = ExplodeTree(Data=demesh.Vertices)  # -> Branch0, Branch1, Branch2
cp = ClosestPoint(Point=graft([bang.Branch0, bang.Branch1, bang.Branch2, bang.Branch3, bang.Branch4, bang.Branch5]), Cloud=bang_2.Branch0)  # -> ClosestPoint, CPIndex, Distance
cp_2 = ClosestPoint(
    Point=graft([bang.Branch6, bang.Branch7, bang.Branch8, bang.Branch9, bang.Branch10, bang.Branch11]),
    Cloud=bang_2.Branch1)  # -> ClosestPoint, CPIndex, Distance
cp_3 = ClosestPoint(
    Point=graft([bang.Branch12, bang.Branch13, bang.Branch14, bang.Branch15, bang.Branch16, bang.Branch17]),
    Cloud=bang_2.Branch2)  # -> ClosestPoint, CPIndex, Distance
vertexloads = VertexLoads(Mesh=refine, Strength=neg)
medges = MeshEdges(Mesh=refine)  # -> NakedEdges, InteriorEdges, NonManifoldEdges
anchor = Anchor(Point=[cp.ClosestPoint, cp_2.ClosestPoint, cp_3.ClosestPoint], Strength=10000)
len = Length(Curve=[medges.InteriorEdges, medges.NakedEdges])
multiplication = Multiplication(A=len, B=Slider(0, range=0..1))
length_line = LengthLine(Line=[medges.NakedEdges, medges.InteriorEdges], Length=multiplication, Strength=Slider(33, range=0..1000))
solver = Solver(GoalObjects=[anchor, vertexloads, length_line], Reset=Button(), Threshold=1e-15, Tolerance=0.0001, On=Toggle(False))  # -> I, V, O
clean = CleanTree(RemoveNulls=True, RemoveInvalid=True, RemoveEmpty=False, Tree=solver.O)
panel = Panel(clean)
wbweave = WeaverbirdsMeshFromLinesWeaveBack(Lines=clean, MaximumValence=4)
