# Grasshopper definition tower.gh (Grasshopper 1.0.7)
# plug-ins: Kangaroo2 Components

Z = UnitZ(Factor=1)
line = LineSDL(Start=Z, Direction=Vector(0, 0, 1), Length=Slider(478, range=0..1000))
crv = Curve(<curve referenced from the Rhino model>)
revsrf = Revolution(Curve=crv, Axis=line, Domain=Domain(0, 6.283185307))
mesh = MeshBrep(
    Brep=revsrf,
    Settings={GridMaxCount=0, GridMinCount=16, JaggedSeams=False, MaxEdgeLength=0, MinEdgeLength=0.0001, MinTolerance=0, Refine=True, RefineAngle=0, RelativeTolerance=0.65, SimplePlanes=True, Tolerance=0})
triremesh = TriRemesh(Geometry=mesh, Iterations=25)  # -> Triangulation, Dual, Creases
demesh = DeconstructMesh(Mesh=triremesh.Triangulation)  # -> Vertices, Faces, Colours, Normals
dom = ConstructDomain(DomainStart=Slider(-0.2, range=-1..1), DomainEnd=Slider(0.8, range=0..3))
lng = ListLength(List=demesh.Vertices)
pdecon = Deconstruct(Point=demesh.Vertices)  # -> XComponent, YComponent, ZComponent
random = Random(Range=dom, Number=lng, Seed=Slider(10, range=0..10))
random_2 = Random(Range=dom, Number=lng, Seed=Slider(3, range=0..10))
multiplication = Multiplication(A=pdecon.YComponent, B=random_2)
multiplication_2 = Multiplication(A=pdecon.XComponent, B=random)
vec = VectorXYZ(XComponent=multiplication_2, YComponent=multiplication, ZComponent=pdecon.ZComponent)  # -> Vector, Length
pdeform = PointDeform(Geometry=triremesh.Triangulation, Points=demesh.Vertices, Motion=vec.Vector)
number_slider = Slider(3, range=0..10)
msmooth = SmoothMesh(Mesh=pdeform, Strength=0.5, SkipNaked=True, Iterations=Slider(2, range=0..10))
dom_2 = ConstructDomain(DomainStart=Slider(1, range=0.1..5), DomainEnd=Slider(3, range=1..20))
popgeo = PopulateGeometry(Geometry=msmooth, Count=100, Seed=number_slider)
lng_2 = ListLength(List=popgeo)
random_3 = Random(Range=dom_2, Number=lng_2, Seed=number_slider)
sph = Sphere(Base=popgeo, Radius=random_3)
line_2 = LineSDL(Start=popgeo, Direction=Vector(0, 0, 1), Length=random_3)
stretch = Stretch(Geometry=sph, Axis=line_2, Length=Slider(0.9, range=0..1), Rigid=False)
