# Grasshopper definition vines.gh (Grasshopper 1.0.7)

mesh = Mesh(<mesh referenced from the Rhino model>)
popgeo = PopulateGeometry(Geometry=<mesh referenced from the Rhino model>, Count=Slider(91, range=0..100), Seed=Slider(12, range=0..100))
pdecon = Deconstruct(Point=popgeo)  # -> XComponent, YComponent, ZComponent
subdmesh = SubDFromMesh(Mesh=mesh, Creases=1, Corners=1, Interpolate=False)
sort = SortList(Keys=pdecon.ZComponent, ValuesA=popgeo)  # -> Keys, ValuesA
nurbs = NurbsCurve(Vertices=sort.ValuesA, Degree=3, Periodic=False)  # -> Curve, Length, Domain
pulltomesh = CSharpScript(curve=nurbs.Curve, mesh=mesh)  # -> out, A; inputs curve: Curve, mesh: Mesh
# ---------- pulltomesh: C# usings ----------
using System.IO;
using System.Linq;
using System.Data;
using System.Drawing;
using System.Reflection;
using System.Windows.Forms;
using System.Xml;
using System.Xml.Linq;
using System.Runtime.InteropServices;

using Rhino.DocObjects;
using Rhino.Collections;
using GH_IO;
using GH_IO.Serialization;
# ---------- pulltomesh: C# ----------
    if (null != curve && null != mesh)
    {
      var tol = RhinoDoc.ActiveDoc.ModelAbsoluteTolerance;
      A = curve.PullToMesh(mesh, tol);
    }
# ---------- end pulltomesh ----------
smoothpline = SmoothPolyline(Polyline=pulltomesh.A, Strength=1, Times=1)
pipe = Pipe(Curve=smoothpline, Radius=Slider(0.6, range=0..1), Caps=2)
