# Grasshopper definition voronoiRing.gh (Grasshopper 1.0.7)

# Select your profile curve here
crv = Curve(<curve referenced from the Rhino model>)
revsrf = Revolution(Curve=crv, Axis=Line((0, 0, 0), (0, 0, 1)), Domain=Domain(0, 6.283185307))
popgeo = PopulateGeometry(Geometry=revsrf, Count=Slider(230, range=0..1000), Seed=1)
brep = Brep(revsrf)
voronoi³ = Voronoi3D(Points=popgeo, Box={Plane=PlaneXY(-14, -14, -4), X=Domain(0, 28), Y=Domain(0, 28), Z=Domain(0, 7)})  # -> Cells, Boundary
trim = TrimSolid(Shape=brep, Cutters=flatten(voronoi³.Cells))
trim_2 = TrimSolid(Shape=flatten(voronoi³.Cells), Cutters=brep)
join = BrepJoin(Breps=[trim_2, trim])  # -> flatten(Breps), Closed
area = Area(Geometry=join.Breps)  # -> Area, Centroid
brepinc = PointInBrep(Brep=brep, Point=area.Centroid, Strict=False)
dispatch = Dispatch(List=join.Breps, DispatchPattern=brepinc)  # -> ListA, ListB
brep_2 = Brep(dispatch.ListB)
sift = SiftPattern(List=brep_2, SiftPattern=[0, 0, 1, 1])  # -> Output0, Output1
volume = Volume(Geometry=sift.Output1)  # -> Volume, Centroid
volume_2 = Volume(Geometry=sift.Output0)  # -> Volume, Centroid
scale = Scale(Geometry=sift.Output1, Center=volume.Centroid, Factor=Slider(0.88, range=0..1))  # -> Geometry, Transform
scale_2 = Scale(Geometry=sift.Output0, Center=volume_2.Centroid, Factor=Slider(1.13, range=0..10))  # -> Geometry, Transform
