# Grasshopper definition wicker.gh (Grasshopper 1.0.7)

# ---- group: Base
pt = Point(Point(0, 0, 0))
Z = UnitZ(Factor=1)
circle = CircleCNR(Center=pt, Normal=Z, Radius=Slider(23, range=0..100))

# ----
vec = VectorXYZ(XComponent=0, YComponent=Slider(300, range=0..1000), ZComponent=0)  # -> Vector, Length
move = Move(Geometry=pt, Motion=vec.Vector)  # -> Geometry, Transform
arrpolar = PolarArray(Geometry=move.Geometry, Plane=PlaneXY(0, 0, 0), Count=6, Angle=6.283185307)  # -> Geometry, Transform
height = Slider(130, range=0..1000)
dom = ConstructDomain(DomainStart=0.6, DomainEnd=1)
dom_2 = ConstructDomain(DomainStart=0, DomainEnd=0.5)
random = Random(Range=dom_2, Number=6, Seed=69)
random_2 = Random(Range=dom_2, Number=6, Seed=420)
random_3 = Random(Range=dom, Number=6, Seed=37)

# ---- group: ArrayBases
Z_2 = UnitZ(Factor=1)
circle_2 = CircleCNR(Center=arrpolar.Geometry, Normal=Z_2, Radius=Slider(23, range=0..100))

# ----
pt_2 = ConstructPoint(XCoordinate=0, YCoordinate=0, ZCoordinate=height)
vec_2 = VectorXYZ(XComponent=Slider(0.5, range=0..1), YComponent=random_2, ZComponent=Slider(1, range=0..1))  # -> Vector, Length
pt_3 = Point(Point(0, 0, 10))
loft_opt = LoftOptions(Closed=True, Adjust=False, Rebuild=3, Refit=0, Type=3)
boundary = BoundarySurfaces(Edges=circle_2)

# ---- group: Roof
height_2 = Slider(130, range=0..1000)
pt_4 = ConstructPoint(XCoordinate=0, YCoordinate=0, ZCoordinate=height_2)
vec_3 = VectorXYZ(XComponent=Slider(0.5, range=0..1), YComponent=Slider(0, range=0..1), ZComponent=Slider(1, range=0..1))  # -> Vector, Length

# ----
move_2 = Move(Geometry=pt, Motion=pt_4)  # -> Geometry, Transform

# ---- group: Roof (continued)
circle_3 = CircleCNR(Center=move_2.Geometry, Normal=vec_3.Vector, Radius=Slider(16, range=0..100))

# ----
number_slider = Slider(12, range=0..100)
knob = ControlKnob(Decimals=2, Limit=True, Maximum=10, Minimum=0, Range=1, Value=0.75)
multiplication = Multiplication(A=knob, B=3.141592654)
divide = DivideCurve(Curve=circle, Count=number_slider, Kinks=False)  # -> Points, Tangents, Parameters
divide_2 = DivideCurve(Curve=circle_3, Count=number_slider, Kinks=False)  # -> Points, Tangents, Parameters
neg = Negative(Value=multiplication)
rot3d = Rotate3D(Geometry=divide_2.Points, Angle=neg, Center=move_2.Geometry, Axis=vec_3.Vector)  # -> Geometry, Transform
rot3d_2 = Rotate3D(Geometry=divide_2.Points, Angle=multiplication, Center=move_2.Geometry, Axis=vec_3.Vector)  # -> Geometry, Transform

move_3 = Move(Geometry=arrpolar.Geometry, Motion=pt_4)  # -> Geometry, Transform
line = LineSDL(Start=move_3.Geometry, Direction=vec_2.Vector, Length=Slider(130, range=0..1000))
circle_4 = CircleCNR(Center=move_3.Geometry, Normal=vec_2.Vector, Radius=Slider(16, range=0..100))
ln = Line(StartPoint=divide.Points, EndPoint=rot3d_2.Geometry)
ln_2 = Line(StartPoint=divide.Points, EndPoint=rot3d.Geometry)
shift = ShiftList(List=circle_4, Shift=1, Wrap=True)

number_slider_2 = Slider(6, range=0..100)
knob_2 = ControlKnob(Decimals=2, Limit=True, Maximum=10, Minimum=0, Range=1, Value=0.75)
multiplication_2 = Multiplication(A=knob_2, B=3.141592654)
divide_3 = DivideCurve(Curve=circle_2, Count=number_slider_2, Kinks=False)  # -> Points, Tangents, Parameters
divide_4 = DivideCurve(Curve=graft(circle_4), Count=number_slider_2, Kinks=False)  # -> Points, Tangents, Parameters
neg_2 = Negative(Value=multiplication_2)

crvprox = CurveProximity(CurveA=shift, CurveB=circle_4)  # -> PointA, PointB, Distance
addition = Addition(A=crvprox.Distance, B=Slider(12, range=0..100))
crvprox_2 = CurveProximity(CurveA=shift, CurveB=circle_3)  # -> PointA, PointB, Distance
addition_2 = Addition(A=crvprox_2.Distance, B=Slider(12, range=0..100))
cat = Catenary(PointA=crvprox.PointA, PointB=crvprox.PointB, Length=addition, Gravity=pt_3)
rotate = Rotate(Geometry=divide_3.Points, Angle=multiplication_2, Plane=graft(arrpolar.Geometry))  # -> Geometry, Transform
rotate_2 = Rotate(Geometry=divide_3.Points, Angle=neg_2, Plane=graft(arrpolar.Geometry))  # -> Geometry, Transform
cat_2 = Catenary(PointA=crvprox_2.PointA, PointB=crvprox_2.PointB, Length=addition_2, Gravity=pt_3)
ln_3 = Line(StartPoint=rotate.Geometry, EndPoint=divide_4.Points)
ln_4 = Line(StartPoint=rotate_2.Geometry, EndPoint=divide_4.Points)
loft = Loft(Curves=[cat, cat_2], Options=loft_opt)
