# Grasshopper definition wrinkly.gh (Grasshopper 0.9.76)
# plug-ins: Kangaroo Components, PlanktonGh, Weaverbird, Kangaroo2 Components

cir = Circle(Plane=PlaneXY(0, 0, 0), Radius=12)
end = EndPoints(Curve=cir)  # -> Start, End
mesh = Mesh(cir)
sequence = Sequence(Frames=2)
meshmachine = MeshMachine(
    Geometry=mesh,
    Length=3,
    FixCurves=cir,
    FixVertices=end.Start,
    Flip=1,
    PullStrength=0.8,
    CurvatureAdaptivity=0,
    BoundaryScale=0.1,
    BoundaryDistance=5,
    Exponent=2,
    Background=0.5,
    Iterations=40,
    Reset=sequence)
item = ListItem(List=reverse(meshmachine), Index=0, Wrap=True)
pmesh = PlanktonMesh(item)
mesh_2 = Mesh(pmesh)
rotate = Rotate(Geometry=mesh_2, Angle=0.1, Plane=PlaneYZ(0, 0, 0))  # -> Geometry, Transform
dam = DataDam(DataA=rotate.Geometry, BufferDelay=10000000, BufferMode=0)
medges = MeshEdges(Mesh=dam)  # -> NakedEdges, InteriorEdges, NonManifoldEdges
show = Show(G=dam)
demesh = DeconstructMesh(Mesh=dam)  # -> Vertices, Faces, Colours, Normals
join = JoinCurves(Curves=medges.NakedEdges, Preserve=False)
length_line = LengthLine(Line=[medges.NakedEdges, medges.InteriorEdges], Strength=0.2)
grab = Grab(On=True, Strength=1, Range=3)  # -> Grab, Anchors
smooth = Smooth(M=dam, Strength=25)
explode = Explode(Curve=join, Recursive=True)  # -> Segments, Vertices
sc = SphereCollide(Points=demesh.Vertices, Radius=3, Strength=1)
shift = ShiftList(List=explode.Segments, Shift=1, Wrap=True)
angle = Angle(LineA=explode.Segments, LineB=shift, RestAngle=0, Strength=10)
solver = Solver(
    GoalObjects=[length_line, sc, show, grab.Grab, smooth, angle],
    Reset=Button(),
    Restart=False,
    Parallel=True,
    Threshold=1e-15,
    Tolerance=0.01,
    AddCurrent=False,
    On=Toggle(True))  # -> V, O
item_2 = ListItem(List=solver.O, Index=0, Wrap=True)
wbloop = WeaverbirdsLoopSubdivision(MeshCurves=item_2, Level=2, SmoothNakedEdges=1)
